# Grasshopper definition Components.gh (Grasshopper 1.0.8)
# plug-ins: eleFront, Swiftlet

param = DefineToolParameter(Name="point_b", Type="string", Description="end point for bridge generation formatted as \"x, y, z\"", Required=True)
param_2 = DefineToolParameter(Name="point_a", Type="string", Description="start point for bridge generation formatted as \"x, y, z\"", Required=True)
panel = Panel("generates a representation of a bridge between two points, based on an input width")
panel_2 = Panel("analyzes the connectivity of the current massing representations")
panel_3 = Panel("gets the current outlines of the massing that lives in the Rhino model and finds the center points")
merge = Merge(Data1=param_2, Data2=param)
tool = DefineTool(Name="connectivity_analysis", Description=panel_2)
tool_2 = DefineTool(Name="get_massing_centers", Description=panel_3)
tool_3 = DefineTool(Name="create_bridge", Description=panel, Parameters=merge)
merge_2 = Merge(Data1=tool_3, Data2=tool_2, Data3=tool)
mcp = MCPServer(Port=3001, Tools=merge_2, ServerName="DAVE")  # -> Create_bridge, Get_massing_centers, Connectivity_analysis

decall = DeconstructToolCall(Request=mcp.Create_bridge)  # -> Request, Tool, Arguments
gjok = GetJSONObjectKey(JObject=decall.Arguments, Key="point_a")
gjok_2 = GetJSONObjectKey(JObject=decall.Arguments, Key="point_b")
rjv = ReadJSONValue(JValue=gjok)  # -> AsString, AsNumber, AsBool
rjv_2 = ReadJSONValue(JValue=gjok_2)  # -> AsString, AsNumber, AsBool
split = TextSplit(Text=rjv.AsString, Separators=",")
split_2 = TextSplit(Text=rjv_2.AsString, Separators=",")
trim = TextTrim(Text=split, Start=True, End=True)
trim_2 = TextTrim(Text=split_2, Start=True, End=True)
item = ListItem(List=trim, Index=1, Wrap=True)
item_2 = ListItem(List=trim, Index=2, Wrap=True)
item_3 = ListItem(List=trim, Index=0, Wrap=True)
item_4 = ListItem(List=trim_2, Index=1, Wrap=True)
item_5 = ListItem(List=trim_2, Index=2, Wrap=True)
item_6 = ListItem(List=trim_2, Index=0, Wrap=True)
pt = ConstructPoint(XCoordinate=item_3, YCoordinate=item, ZCoordinate=item_2)
pt_2 = ConstructPoint(XCoordinate=item_6, YCoordinate=item_4, ZCoordinate=item_5)

py3 = Python3Script(prefix="bridge")  # -> random_id; inputs prefix: String
# ---------- py3: Python ----------
import random

id = random.randint(1000000, 9999999)
random_id = f"{prefix}-{id}"
# ---------- end py3 ----------
null = NullItem(Item=decall.Request)  # -> NullFlags, InvalidFlags, Description
not = GateNot(A=null.NullFlags)
bridge_name = Panel(py3)
bool = Boolean(not)
decall_2 = DeconstructToolCall(Request=mcp.Connectivity_analysis)  # -> Request, Tool, Arguments

# ----
# Create Bridge (Point A to Point B)
number_slider = Slider(2, range=0..10)
bridge_width = Number(number_slider)
point_a = Point(pt)
point_b = Point(pt_2)
ln = Line(StartPoint=point_a, EndPoint=point_b)  # -> simplify(Line)
panel_4 = Panel("""0
1""")
pframe = PerpFrame(Curve=reparameterize(ln), Parameter=panel_4)
deplane = DeconstructPlane(Plane=pframe)  # -> Origin, XAxis, YAxis, ZAxis

# ---- group: Perp Vector Road Width
multiplication = Multiplication(A=bridge_width, B=deplane.YAxis)
multiplication_2 = Multiplication(A=bridge_width, B=deplane.YAxis)  # -> simplify(graft(Result))
multiplication_3 = Multiplication(A=multiplication, B=-1)  # -> simplify(graft(Result))

# ---- group: Bridge Width
merge_3 = Merge(Data1=point_a, Data2=point_b)  # -> graft(Result)
move = Move(Geometry=merge_3, Motion=[multiplication_2, multiplication_3])  # -> Geometry, Transform
flip = FlipMatrix(Data=move.Geometry)

# ----
intcrv = Interpolate(Vertices=move.Geometry, Degree=3, Periodic=False, KnotStyle=1)  # -> Curve, Length, Domain
intcrv_2 = Interpolate(Vertices=flip, Degree=3, Periodic=False, KnotStyle=1)  # -> Curve, Length, Domain
join = JoinCurves(Curves=flatten([intcrv_2.Curve, intcrv.Curve]), Preserve=False)  # -> simplify(Curves)
boundary = BoundarySurfaces(Edges=join)

# ---- group: Bridge Surfaces
geo = Geometry(boundary)

# ----
py3_2 = Python3Script(geometry=geo, name=bridge_name, bake=bool)  # -> result, error; inputs geometry: GeometryBase, name: String, bake: Boolean
# ---------- py3_2: Python ----------
import Rhino
import scriptcontext as sc
import System
import json

if bake:
    error = True
    sc.doc = Rhino.RhinoDoc.ActiveDoc

    # Get or create the DAVE_OUT_BRIDGES layer
    layer_name = "DAVE_OUT_BRIDGES"
    layer_index = sc.doc.Layers.FindByFullPath(layer_name, -1)
    if layer_index == -1:
        new_layer = Rhino.DocObjects.Layer()
        new_layer.Name = layer_name
        layer_index = sc.doc.Layers.Add(new_layer)

    # Bake with layer assigned
    attr = Rhino.DocObjects.ObjectAttributes()
    attr.LayerIndex = layer_index
    obj_id = sc.doc.Objects.Add(geometry, attr)

    if obj_id != System.Guid.Empty:
        obj = sc.doc.Objects.Find(obj_id)
        if obj:
            attr = obj.Attributes.Duplicate()
            attr.Name = name
            sc.doc.Objects.ModifyAttributes(obj_id, attr, True)

            bbox = obj.Geometry.GetBoundingBox(True)
            geo_type = obj.Geometry.GetType().Name
            result = json.dumps({
                "name": name,
                "type": geo_type,
                "id": str(obj_id)   # <-- pass GUID back to MCP
            })
            error = False
        else:
            result = json.dumps({"err": "Object not found after add"})
        sc.doc.Views.Redraw()
    else:
        result = json.dumps({"err": "Failed to bake geometry"})
    sc.doc = ghdoc
else:
    result = json.dumps({"msg": "Bake is False, skipping"})
    error = False
# ---------- end py3_2 ----------
pjs = ParseJSONString(Text=py3_2.result)
response = Panel(py3_2.result)
mcp_txt = CreateMCPTextContent(Text=pjs)
respond = MCPToolResponse(Request=decall.Request, ContentBlocks=mcp_txt, IsError=py3_2.error)

# ----
# Get Massing Centers
decall_3 = DeconstructToolCall(Request=mcp.Get_massing_centers)  # -> Request, Tool, Arguments
pipeline = GeometryPipeline(
    GroupByLayer=False,
    GroupByType=False,
    IncludeHidden=True,
    IncludeLocked=True,
    LayerFilter="Default",
    NameFilter="*",
    SublayerFiltering=True,
    TypeFilter=4)
geo_2 = Geometry(pipeline)
cls = Closed(Curve=geo_2)  # -> Closed, Periodic
cull = CullPattern(List=geo_2, CullPattern=cls.Closed)
area = Area(Geometry=cull)  # -> Area, Centroid
panel_5 = Panel(area.Centroid)

cjv = CreateJSONValue(Value=panel_5)
cjo = CreateJSONObject(Keys=panel_5, Values=cjv)
sjt = StringifyJSONToken(JToken=cjo)
mcp_txt_2 = CreateMCPTextContent(Text=sjt)

respond_2 = MCPToolResponse(Request=decall_3.Request, ContentBlocks=mcp_txt_2, IsError=False)

# ----
# Connectivity
pipeline_2 = GeometryPipeline(
    GroupByLayer=False,
    GroupByType=False,
    IncludeHidden=True,
    IncludeLocked=True,
    LayerFilter="Default",
    NameFilter="*",
    SublayerFiltering=True,
    TypeFilter=4)
geo_3 = Geometry(pipeline_2)

# ---- group: Checks if closed curve
area_2 = Area(Geometry=geo_3)  # -> Area, Centroid
null_2 = NullItem(Item=area_2.Area)  # -> NullFlags, InvalidFlags, Description
dispatch = Dispatch(List=geo_3, DispatchPattern=null_2.NullFlags)  # -> ListA, ListB

# ----
rhatt = GetRhinoAttributes(Geometry=dispatch.ListB, fullpath=False)  # -> Name, Layer, Color, MaterialName, SourceFile
cset = CreateSet(List=rhatt.Color)  # -> Set, Map
tstat = TreeStatistics(Tree=cset.Set)  # -> Paths, Length, Count
area_3 = Area(Geometry=dispatch.ListB)  # -> Area, Centroid
series = Series(Start=0, Step=1, Count=tstat.Length)
associated_color_index = Data(series)
py3_3 = Python3Script(Pts=area_3.Centroid, IDs=rhatt.Name, Index=cset.Map)  # -> out, result, error; inputs Pts: list of Point3d, IDs: list of String, Index: list of Int32
# ---------- py3_3: Python ----------
"""
Grasshopper Python Script

Purpose:
    Calculates the distance between each unique pair of input points.

    Each point/object has:
        1. A point location
        2. An identification number
        3. An associated index, such as a color/category index

    The script keeps track of both objects involved in each connection.

Inputs:
    Pts   : List of points
    IDs   : List of identification numbers, one per point
    Index : List of associated index/color/category values, one per point

Outputs:
    result : JSON string for MCP
    error  : Boolean, True if an error occurred
"""

import Rhino.Geometry as rg
import json


# ------------------------------------------------------------
# Helper functions
# ------------------------------------------------------------

def flatten_input(data):
    if data is None:
        return []
    if isinstance(data, list) or isinstance(data, tuple):
        return list(data)
    if hasattr(data, "Branches"):
        flattened = []
        for branch in data.Branches:
            for item in branch:
                flattened.append(item)
        return flattened
    return [data]


def get_point3d(item):
    if item is None:
        return None
    if isinstance(item, rg.Point3d):
        return item
    if isinstance(item, rg.Point):
        return item.Location
    if hasattr(item, "Location") and isinstance(item.Location, rg.Point3d):
        return item.Location
    return None


# ------------------------------------------------------------
# Normalize inputs
# ------------------------------------------------------------

pts_input   = flatten_input(Pts)
ids_input   = flatten_input(IDs)
index_input = flatten_input(Index)


# ------------------------------------------------------------
# Validate inputs
# ------------------------------------------------------------

notes = []

if len(pts_input) == 0:
    notes.append("Error: No points were provided.")

elif len(ids_input) == 0:
    notes.append("Error: No IDs were provided.")

elif len(index_input) == 0:
    notes.append("Error: No Index values were provided.")

elif len(pts_input) != len(ids_input):
    notes.append(
        "Error: Number of points does not match number of IDs. "
        "Points: {0}, IDs: {1}".format(len(pts_input), len(ids_input))
    )

elif len(pts_input) != len(index_input):
    notes.append(
        "Error: Number of points does not match number of Index values. "
        "Points: {0}, Index values: {1}".format(len(pts_input), len(index_input))
    )


# ------------------------------------------------------------
# Early exit on validation errors
# ------------------------------------------------------------

if notes:
    result = json.dumps({"msg": notes[0]})
    error  = True

else:
    points  = []
    ids     = []
    indices = []
    invalid_point_indices = []

    for i in range(len(pts_input)):
        pt = get_point3d(pts_input[i])
        if pt is None:
            invalid_point_indices.append(i)
        else:
            points.append(pt)
            ids.append(ids_input[i])
            indices.append(index_input[i])

    if invalid_point_indices:
        result = json.dumps({
            "msg": "Error: Invalid point input at indices: {0}".format(invalid_point_indices)
        })
        error = True

    elif len(points) < 2:
        result = json.dumps({
            "msg": "Error: At least two valid points are required."
        })
        error = True

    else:
        # ------------------------------------------------------------
        # Calculate unique unordered pairs
        # ------------------------------------------------------------

        Distance   = []
        Connection = []
        FromID     = []
        ToID       = []
        FromIndex  = []
        ToIndex    = []
        PairLabel  = []

        count = len(points)

        for i in range(count):
            for j in range(i + 1, count):
                pt_a    = points[i]
                pt_b    = points[j]
                id_a    = ids[i]
                id_b    = ids[j]
                index_a = indices[i]
                index_b = indices[j]

                dist = pt_a.DistanceTo(pt_b)
                line = rg.Line(pt_a, pt_b)

                Distance.append(dist)
                Connection.append(line)
                FromID.append(id_a)
                ToID.append(id_b)
                FromIndex.append(index_a)
                ToIndex.append(index_b)
                PairLabel.append(
                    "ID {0} | Index {1}  <-->  ID {2} | Index {3} | Distance {4}".format(
                        id_a, index_a, id_b, index_b, round(dist, 4)
                    )
                )

        result = json.dumps({
            "msg": "Connectivity analysis complete",
            "connection_count": len(Distance),
            "connections": [
                {
                    "from_id":    FromID[i],
                    "to_id":      ToID[i],
                    "from_index": FromIndex[i],
                    "to_index":   ToIndex[i],
                    "distance":   round(Distance[i], 4),
                    "line": {
                        "from": [round(Connection[i].From.X, 2),
                                 round(Connection[i].From.Y, 2),
                                 round(Connection[i].From.Z, 2)],
                        "to":   [round(Connection[i].To.X, 2),
                                 round(Connection[i].To.Y, 2),
                                 round(Connection[i].To.Z, 2)]
                    },
                    "label": PairLabel[i]
                }
                for i in range(len(Distance))
            ],
            "notes": [
                "Calculated {0} unique connections from {1} objects.".format(
                    len(Distance), count
                ),
                "Expected pair count: {0}.".format(int(count * (count - 1) / 2)),
                "Self-distances and duplicate reverse pairs excluded."
            ]
        })
        error = False
# ---------- end py3_3 ----------
color = Data(cset.Set)

panel_6 = Panel(py3_3.result)
mcp_txt_3 = CreateMCPTextContent(Text=py3_3.result)
respond_3 = MCPToolResponse(Request=decall_2.Request, ContentBlocks=mcp_txt_3, IsError=py3_3.error)
